# Grasshopper definition data_ex.gh (Grasshopper 1.0.7)
# plug-ins: Bifocals

series = Series(Start=0, Step=Slider(5, range=1..5), Count=Slider(32, range=10..100))
number_slider = Slider(0, range=0..1)
construct_point = ConstructPoint(XCoordinate=series, YCoordinate=0, ZCoordinate=0)
panel = Panel(series)
square = Square(Plane=PlaneXY(0, 0, 0), Size=Slider(1, range=0..1), ExtentX=Slider(6, range=5..20), ExtentY=Slider(9, range=5..20))  # -> Cells, Points
point_list = PointList(Points=construct_point, Size=Slider(3.456, range=0..10))
point_order = PointOrder(Points=construct_point)
point = Point(square.Points)
flatten_tree = FlattenTree(Tree=square.Points, Path="{0}")
point_list_2 = PointList(Points=flatten_tree, Size=Slider(0.5, range=0.5..5))
