# Grasshopper definition points_cones_ex.gh (Grasshopper 1.0.7)
# plug-ins: Bifocals

# Points / Cones Example
# by RJ Duran (rj.duran@colorado.edu)
# CM3: Parametric Product Design, Spring 2020
# http://make.cmci.studio
# 1. Right click on point param
# and set multiple points defined in Rhino
# Example 1: Points
# Example 2: Random Points and Cones
point = Point([<point referenced from the Rhino model> x14])
number_slider = Slider(85, range=20..100)
# 2. Extract X and Y components of each point
# and display them in two lists
deconstruct = Deconstruct(Point=point)  # -> XComponent, YComponent, ZComponent
panel = Panel(point)
# 1. Set boundary (rectangle)
curve = Curve(<curve referenced from the Rhino model>)
# 3. Generate a list of random values
# within a range and use the values
# to set height of each cone.
construct_domain = ConstructDomain(DomainStart=Slider(10, range=0..10), DomainEnd=Slider(20, range=0..100))
X = Panel(deconstruct.XComponent)
Y = Panel(deconstruct.YComponent)
# 2. Fill bounds with a
# bunch of random points
populate_2d = Populate2D(Region=curve, Count=number_slider, Seed=1)
random = Random(Range=construct_domain, Number=number_slider, Seed=2)
integer = Integer(random)
multiplication = Multiplication(A=random, B=Slider(0.527, range=0..1))
# 4. Place a cone at each point
# and set height and radius.
cone = Cone(Base=populate_2d, Radius=Slider(1.822, range=0..10), Length=multiplication)  # -> Cone, Tip
# 5. Bake the grouped cone objects.
# Right click on component > Bake
group = Group(Objects=cone.Cone)
