# Grasshopper definition laser_cut_panel_ex.gh (Grasshopper 1.0.7)
# plug-ins: Bifocals

number_slider = Slider(8, range=1..10)
number_slider_2 = Slider(0.125, range=0.0625..0.25)
square = Square(Plane=PlaneXY(0, 0, 0), Size=1, ExtentX=number_slider, ExtentY=number_slider)  # -> Cells, Points
offset_curve = OffsetCurve(Curve=square.Cells, Distance=number_slider_2, Plane=PlaneXY(0, 0, 0), Corners=1)
offset_curve_2 = OffsetCurve(Curve=square.Cells, Distance=expr("-x", number_slider_2), Plane=PlaneXY(0, 0, 0), Corners=1)
boundary_surfaces = BoundarySurfaces(Edges=[offset_curve, offset_curve_2])  # -> flatten(Surfaces)
curve = Curve([offset_curve, offset_curve_2])
solid_union = SolidUnion(Breps=boundary_surfaces)
brep_edges = BrepEdges(Brep=solid_union)  # -> Naked, Interior, NonManifold
addition = Addition(A=number_slider, B=Slider(1, range=1..3))
join_curves = JoinCurves(Curves=brep_edges.Naked, Preserve=False)
unit_x = UnitX(Factor=addition)
unit_y = UnitY(Factor=addition)
curve_2 = Curve(join_curves)
move = Move(Geometry=curve_2, Motion=unit_x)  # -> Geometry, Transform
boundary_surfaces_2 = BoundarySurfaces(Edges=curve_2)
unit_z = UnitZ(Factor=Slider(0.25, range=0..1))
vector_xyz = VectorXYZ(XComponent=unit_x, YComponent=unit_y, ZComponent=0)  # -> Vector, Length
extrude = Extrude(Base=boundary_surfaces_2, Direction=unit_z)
move_2 = Move(Geometry=extrude, Motion=vector_xyz.Vector)  # -> Geometry, Transform

# ---- group: Bake Me!
surface = Surface(boundary_surfaces_2)
curve_3 = Curve(move.Geometry)
brep = Brep(move_2.Geometry)
